# Grasshopper definition mydesign.gh (Grasshopper 1.0.7)
# plug-ins: Pufferfish

crv = Curve(<curve referenced from the Rhino model>)
crv_2 = Curve(<curve referenced from the Rhino model>)
crv_3 = Curve(<curve referenced from the Rhino model>)
crv_4 = Curve(<curve referenced from the Rhino model>)
crv_5 = Curve(<curve referenced from the Rhino model>)
loft = Loft(Curves=[crv, crv_2], Options={Adjust=False, Closed=False, LoftEnds=0, LoftSimp=0, LoftType=3, Rebuild=10, Refit=0.01})
loft_2 = Loft(
    Curves=[crv_2, crv_3, crv_4, crv_5],
    Options={Adjust=False, Closed=False, LoftEnds=0, LoftSimp=0, LoftType=3, Rebuild=10, Refit=0.01})
debrep = DeconstructBrep(Brep=loft)  # -> Faces, Edges, Vertices
item = ListItem(List=debrep.Faces, Index=0, Wrap=True)
offsrf = OffsetSurface(Surface=loft_2, Distance=Slider(2, range=0..10), BothSides=0, CreateSolid=Toggle(True))
srf = Surface(item)
divide = DivideDomain²(Domain=srf, UCount=Slider(1, range=0..10), VCount=Slider(50, range=0..100))
subsrf = Isotrim(Surface=srf, Domain=divide)
merge = Merge(Data1=Toggle(True), Data2=Toggle(False))
cull = CullPattern(List=subsrf, CullPattern=merge)
offsrf_2 = OffsetSurface(Surface=cull, Distance=Slider(2, range=0..10), BothSides=0, CreateSolid=Toggle(True))
merge_2 = Merge(Data1=offsrf_2, Data2=offsrf)
